# Dynamo graph MortaGetTableData.dyn "MortaAPICall" (Dynamo 2.16.2.5624)

api_key = StringInput("")
tableID = StringInput("")
python_script = Python(IN[0]=api_key, IN[1]=tableID)  # CPython3
# ---------- python_script.python (67 lines) ----------
import sys
import clr
import time
import json
from System import *
from System.IO import StreamReader
from System.Net import HttpWebRequest, WebHeaderCollection

dataEnteringNode = IN
api_key = IN[0]
tableid = IN[1]

def mortapagecall(tableid, api_key, size):
    base_url = "https://api.morta.io/v1/table/" + tableid + "/row"
    data = []
    next_page_token = ""
    
    while True:
        # Update URL with pagination token if available
        url = base_url + "?size=" + str(size)
        if next_page_token:
            url += "&nextPageToken=" + next_page_token
        
        # Create and configure the request
        req = HttpWebRequest.Create(url)
        req.Method = "GET"
        req.Headers = WebHeaderCollection()
        req.Headers.Add("Authorization", "Bearer " + api_key)
        req.UserAgent = "IronPython"
        req.Accept = 'application/json'
     
        # Execute the request
        response = req.GetResponse()
        stream = response.GetResponseStream()
        reader = StreamReader(stream)
        response_text = reader.ReadToEnd()
        
        # Parse JSON response
        response_data = json.loads(response_text)
        for item in response_data["data"]:
            if "rowData" in item:
                data.append(item["rowData"])
        
        
        # Check for next page token
        if "metadata" in response_data and "nextPageToken" in response_data["metadata"]:
            next_page_token = response_data["metadata"]["nextPageToken"]
            if not next_page_token:
                break
        else:
            break
        
        # Clean up
        reader.Close()
        response.Close()
        
        # Delay to avoid overwhelming the server
        time.sleep(1)
    
    return data

# Use the function
data = mortapagecall(tableid, api_key, 2000)
columns = list(data[0].keys())
rowdata = [list(item.values()) for item in data]

OUT =[columns,rowdata]
# ----------------------------------------
